# Grasshopper definition newLb_envimet.gh (Grasshopper 1.0.7)
# plug-ins: ItemSelector

ladybug = Ladybug_Ladybug()  # -> Vviiiiiiiiiizzz; plug-in component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
lb_envimetreadlibrary = Lb_envimetReadLibrary(dataType=Slider(1, range=0..8), keyword="brick")  # -> readMe, profileId, profileData; inputs dataType: Int32
#   port profileId: ENVI-Met profile ID.
#   port profileData: 0 = Id 1 = Description 2 = Microscale roughness length of surface(m) 3 = soil profile 4 = Albedo 5 = Emissivity 6 = ExtraID 7 = Irrigated 8 = Color 9 = Group
# ---------- lb_envimetreadlibrary: Python ----------
# lb_envimet: A series of component for ENVI_MET
# 
# It depends on Ladybug Legacy.
# 
# Copyright (c) 2013-2019, Antonello Di Nunzio <antonellodinunzio@gmail.com> 
# lb_envimet is free software; you can redistribute it and/or modify 
# it under the terms of the GNU General Public License as published 
# by the Free Software Foundation; either version 3 of the License, 
# or (at your option) any later version. 
# 
# lb_envimet is distributed in the hope that it will be useful,
# but WITHOUT ANY WARRANTY; without even the implied warranty of 
# MERCHANTABILITY or FITNESS FOR A PARTICULAR PURPOSE. See the 
# GNU General Public License for more details.
# 
# You should have received a copy of the GNU General Public License
# along with lb_envimet; If not, see <http://www.gnu.org/licenses/>.
# 
# @license GPL-3.0+ <http://spdx.org/licenses/GPL-3.0+>


"""
This component let you select materials from ENVI-Met library.
-
    Args:
        _dataType: Connect an integer from 0 to 8.
        -
        0 = soil
        1 = profile
        2 = material
        3 = wall
        4 = source
        5 = plant
        6 = plant3D
        7 = greening
        8 = simpleWall
        -
        Default value is 0.
        _keyword_: Connect a keyword to filter data. E.g. 'asphalt' (_dataType = 0)
    Returns:
        readMe!: ...
        soilId: ENVI-Met soil ID.
        soilData:
        0 = Id
        1 = Description
        2 = Versiegelung
        3 = Water Contentat Saturation
        4 = Water Content At Field Cap
        5 = WaterContentWiltingPoint
        6 = Matrix Potential
        7 = Hidraulic Conductivity
        8 = Volumetric HeatCapacity
        9 = Clapp Constant
        10 = Heat Conductivity
        11 = Group
        12 = Color
"""

ghenv.Component.Name = "lb_envimet Read Library"
ghenv.Component.NickName = 'lb_envimetReadLibrary'
ghenv.Component.Message = 'VER 0.0.02\nMAR_30_2019'
ghenv.Component.IconDisplayMode = ghenv.Component.IconDisplayMode.application
ghenv.Component.Category = "lb_envimet"
ghenv.Component.SubCategory = "0 | Settings"


import os
import re
import clr
import sys
clr.AddReference("Grasshopper")
clr.AddReference("System.Xml")
import System.Xml
import scriptcontext as sc
import Grasshopper.Kernel as gh
from Grasshopper.Kernel.Data import GH_Path
from Grasshopper import DataTree
##################LB ENVI_MET###################
userPath = os.getenv("APPDATA")
path = os.path.join(userPath, "lb_envimet")
sys.path.append(path)
from IO import ReadEnvimetLib
################################################


outputId = ['soil', 'profile', 'material', 'wall', 'source', 'plant', 'plant3D', 'greening', 'simpleWall']

outputsDict = {
0: ["readMe!", "..."],
1: ["soilId", "ENVI-Met soil ID."],
2: ["soilData", "0 = Id\n1 = Description\n2 = Versiegelung\n3 = Water Contentat Saturation\n4 = Water Content At Field Cap\n5 = WaterContentWiltingPoint" + \
"6 = Matrix Potential\n7 = Hidraulic Conductivity\n8 = Volumetric HeatCapacity\n9 = Clapp Constant\n10 = Heat Conductivity\n11 = Group\n12 = Color"]
}

otherFolderDict = {
'0': "0 = Id\n1 = Description\n2 = Versiegelung\n3 = Water Contentat Saturation\n4 = Water Content At Field Cap\n5 = WaterContent Wilting Point\n" + \
"6 = Matrix Potential\n7 = Hidraulic Conductivity\n8 = Volumetric HeatCapacity\n9 = Clapp Constant\n10 = Heat Conductivity\n11 = Group\n12 = Color",
'1': "0 = Id\n1 = Description\n2 = Microscale roughness length of surface(m)\n3 = soil profile\n4 = Albedo\n5 = Emissivity\n6 = ExtraID\n7 = Irrigated\n8 = Color\n9 = Group",
'2': "0 = Id\n1 = Description\n2 = Thickness\n3 = Absorption\n4 = Transmission\n5 = Reflection\n6 = Emissivity\n7 = SpecificHeat\n8 = Thermal Conductivity\n9 = Density\n10 = ExtraID\n11 = Color\n12 = Group",
'3': "0 = Id\n1 = Description\n2 = Materials\n3 = Thickness Layers(m)\n4 = TypeID\n5 = Color\n6 = Group",
'4': "0 = Id\n1 = Description\n2 = Color\n3 = Group\n4 = DefaultHeight\n5 = Source type\n6 = Special ID\n",
'5': "0 = Id\n1 = Description\n2 = Alternative Name\n3 = Plant type\n4 = Leaf type\n5 = Albedo\n6 = rs_min\n7 = Height\n8 = Root Zone Depth",
'6': "0 = Id and Description\n1 = Alternative Name\n2 = Plant type\n3 = Leaf type\n4 = Albedo\n5 = isoprene\n6 = leaf weigth\n7 = rs_min\n8 = Height\n" + \
"9 = Width\n10 = Depth\n11 = RootDiameter",
'7': "0 = Id\n1 = Name\n2 = Materials\n3 = HasSubstrate\n4 = SoilID\n5 = ThicknessLayers\n6 = subEmissivity\n7 = subAlbedo\n8 = subWaterCoeff\n9 = SimplePlantID\n10 = LAI\n11 = SimplePlantThickness\n12 = LeafAngleDistribution\n13 = AirGap\n15 = Color\n16 = Group\n17 = AddValue1\n18 = AddValue2",
'8': "0 = Id\n1 = Name\n2 = Materials\n3 = RoughnessLength\n4 = Thickness\n5 = Color\n6 = Group"
}


def setComponentOutputs(index):
    for output in range(3):
        if output == 0: 
            ghenv.Component.Params.Output[output].NickName = outputsDict[output][0]
            ghenv.Component.Params.Output[output].Name = outputsDict[output][0]
            ghenv.Component.Params.Output[output].Description = outputsDict[output][1]
        elif output == 1:
            ghenv.Component.Params.Output[output].NickName = outputId[index]+'Id'
            ghenv.Component.Params.Output[output].Name = outputId[index]+'Id'
            ghenv.Component.Params.Output[output].Description = "ENVI-Met {} ID.".format(outputId[index])
        elif output == 2:
            ghenv.Component.Params.Output[output].NickName = outputId[index]+'Data'
            ghenv.Component.Params.Output[output].Name = outputId[index]+'Data'
            ghenv.Component.Params.Output[output].Description = otherFolderDict[str(index)]


def restoreComponentOutputs():
    for output in range(3):
        ghenv.Component.Params.Output[output].NickName = outputsDict[output][0]
        ghenv.Component.Params.Output[output].Name = outputsDict[output][0]
        ghenv.Component.Params.Output[output].Description = outputsDict[output][1]


def makeFolder(subFolder):
    # make a folder
    subFolder = subFolder + '\\'
    appdata = os.getenv("APPDATA")
    try:
        directory = os.path.join(appdata, "Ladybug\ENVIbug", subFolder)
        if not os.path.exists(directory):
            os.makedirs(directory)
    except:
        directory = os.path.join(appdata[:3], "Ladybug\ENVIbug", subFolder)
        if not os.path.exists(directory):
            os.makedirs(directory)
    
    return directory


def ENVIGeometryParser():
    
    def findValue(inputList):
        
        outList = []
        outTree = DataTree[System.Object]()
        
        # mod keyworld
        if _keyword_:
            if _keyword_.isupper() or _keyword_.islower():
                keyword = _keyword_.capitalize()
            else:
                keyword = _keyword_
            
            # id
            for i, data in enumerate(inputList):
                for word in data:
                    if keyword in word:
                        outList.append(data[0])
                        path = GH_Path(i)
                        outTree.AddRange(data, path)
            
        else:
            for i, data in enumerate(inputList):
                outList.append(data[0])
                path = GH_Path(i)
                outTree.AddRange(data, path)
                
        return outList, outTree
    
    
    def findINX():
        appdata = os.getenv("APPDATA")
        directory = os.path.join(appdata[:3], "ENVImet4\sys.basedata\\")
        try:
            if 'database.edb' in os.listdir(directory):
                path = os.path.join(directory, 'database.edb')
                return path
        except:
            w = gh.GH_RuntimeMessageLevel.Warning
            message = "Envimet DataBase not found!."
            ghenv.Component.AddRuntimeMessage(w, message)
            return -1  
    
    
    # path and default folder
    path = findINX()
    folder = makeFolder('DataBase')
    
    # run envimet core
    myFile = ReadEnvimetLib(path)
    soilList, profileList, materialList, wallList, sourceList, plantList, plant3DList, greeningList, simpleWallList = myFile.readLibrary(folder)
    
    
    # plants3D
    plant3DListMod = []
    for innerList in plant3DList:
        plant3DinnerList = []
        for i, element in enumerate(innerList[:12]):
            if i < 1:
                plant3DinnerList.append(element + ',.' + innerList[:12][1])
            else:
                plant3DinnerList.append(element)
        plant3DListMod.append(plant3DinnerList)
    
    
    # run
    soilId, soilData = findValue(soilList)
    profileId, profileData = findValue(profileList)
    materialId, materialData = findValue(materialList)
    wallId, wallData = findValue(wallList)
    sourceId, sourceData = findValue(sourceList)
    plantId, plantData = findValue(plantList)
    plant3DId, plant3DData = findValue(plant3DListMod)
    greeningId, greeningData = findValue(greeningList)
    simpleWallId, simpleWallData = findValue(simpleWallList)
    
    
    return soilId, soilData, profileId, profileData, materialId, materialData, wallId, wallData, sourceId, sourceData, plantId, plantData, plant3DId, plant3DData, greeningId, greeningData, simpleWallId, simpleWallData# metti tutti i possibili output qui


if _dataType > 0: setComponentOutputs(_dataType)
else: restoreComponentOutputs()

soilId, soilData, profileId, profileData, materialId, materialData, wallId, wallData, sourceId, sourceData, plantId, plantData, plant3DId, plant3DData, greeningId, greeningData, simpleWallId, simpleWallData = ENVIGeometryParser()
# ---------- end lb_envimetreadlibrary ----------
lb_envimetreadlibrary_2 = Lb_envimetReadLibrary(dataType=Slider(1, range=0..8), keyword="loamy")  # -> readMe, profileId, profileData; inputs dataType: Int32; same code as lb_envimetreadlibrary
lb_envimetreadlibrary_3 = Lb_envimetReadLibrary(dataType=Slider(3, range=0..8), keyword="brick")  # -> readMe, wallId, wallData; inputs dataType: Int32; same code as lb_envimetreadlibrary
lb_envimetreadlibrary_4 = Lb_envimetReadLibrary(dataType=Slider(1, range=0..8), keyword="asphalt")  # -> readMe, profileId, profileData; inputs dataType: Int32; same code as lb_envimetreadlibrary
lb_envimetreadlibrary_5 = Lb_envimetReadLibrary(dataType=Slider(7, range=0..8))  # -> readMe, greeningId, greeningData; inputs dataType: Int32; same code as lb_envimetreadlibrary
lb_envimetreadlibrary_6 = Lb_envimetReadLibrary(dataType=Slider(6, range=0..8))  # -> readMe, plant3DId, plant3DData; inputs dataType: Int32; same code as lb_envimetreadlibrary
constructlocation = Ladybug_ConstructLocation(
    locationName="MyLocation",
    latitude=Slider(41.91, range=-45.1..45),
    longitude=Slider(12.88, range=-15..15),
    timeZone=0,
    elevation=0)  # -> location; plug-in component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
panel = Panel(lb_envimetreadlibrary.profileData)
panel_2 = Panel(lb_envimetreadlibrary_5.greeningData)
list = Honeybee_ItemSelector(
    lb_envimetreadlibrary_3.wallId,
    {"0100G5", "0100B1", "0100B2", "0100B3", "0000G5", "0000B1", "0000B2", "0000B3"}, selected="0100B2")
list_2 = Honeybee_ItemSelector(lb_envimetreadlibrary_5.greeningId, {"01NAFG", "01NASS", "01NADS", "01AGSS", "01AGDS"}, selected="01NADS")
list_3 = Honeybee_ItemSelector(
    lb_envimetreadlibrary_6.plant3DId,
    {"01SSDM,.Spherical, small trunk, dense, medium (15m)", "01SSDL,.Spherical, small trunk, dense, large (25m)", "01SSDS,.Spherical, small trunk, dense, small (5m)", "01SMDS,.Spherical, medium trunk, dense, small (5m)", "01SLDS,.Spherical, large trunk, dense, small (5m)", "01SMDM,.Spherical, medium trunk, dense, medium (15m)"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}, selected="01OLDS,.Cylindric, large trunk, dense, small (5m)")
list_4 = Honeybee_ItemSelector(lb_envimetreadlibrary.profileId, {"0000KK", "0100KK", "0000KG", "0100KG", "0000BA", "0100BA"}, selected="0000KK")
list_5 = Honeybee_ItemSelector(lb_envimetreadlibrary_2.profileId, {"0000LS", "000000", "0000LO", "0100LO"}, selected="0000LO")
list_6 = Honeybee_ItemSelector(lb_envimetreadlibrary_4.profileId, {"0000ST", "0100ST", "0000AR", "0100AR"}, selected="0000ST")

brep = Brep([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])
brep_2 = Brep(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)
mjoin = MeshJoin(Meshes=brep)
lb_envimetbuilding = Lb_envimetBuilding(geometry=mjoin, wallMaterial=list)  # -> readMe, envimetBuilding; inputs geometry: Mesh
# ---------- lb_envimetbuilding: Python ----------
# lb_envimet: A series of component for ENVI_MET
# 
# It depends on Ladybug Legacy.
# 
# Copyright (c) 2013-2019, Antonello Di Nunzio <antonellodinunzio@gmail.com> 
# lb_envimet is free software; you can redistribute it and/or modify 
# it under the terms of the GNU General Public License as published 
# by the Free Software Foundation; either version 3 of the License, 
# or (at your option) any later version. 
# 
# lb_envimet is distributed in the hope that it will be useful,
# but WITHOUT ANY WARRANTY; without even the implied warranty of 
# MERCHANTABILITY or FITNESS FOR A PARTICULAR PURPOSE. See the 
# GNU General Public License for more details.
# 
# You should have received a copy of the GNU General Public License
# along with lb_envimet; If not, see <http://www.gnu.org/licenses/>.
# 
# @license GPL-3.0+ <http://spdx.org/licenses/GPL-3.0+>


"""
Use this component to generate inputs for "lb_envimet Spaces".
-
Some components depend on Ladybug Legacy, please install Ladybug Legacy.
-
Provided by lb_envimet
    
    Args:
        _geometry: Geometry that represent ENVI-Met buildings.
        -
        Geometry must be closed Brep or closed Mesh. Merge more than one geometry to create a unique Mesh (Eg. Context).
        _wallMaterial_: Use this input to change wall material.
        _roofMaterial_: Use this input to change roof material.
        greenWallMaterial_: Default wall property. Use this input to set default building material.
        -
        If no input is connected this input will be concrete slab '000000'.
        greenRoofMaterial_: Default roof property. Use this input to set default building material.
        -
        If no input is connected this input will be concrete slab '000000'.
    Returns:
        readMe!: ...
        envimetBuilding: Connect this output to "ENVI-Met Spaces" in order to add buildings to ENVI-Met model.
"""

ghenv.Component.Name = "lb_envimet Building"
ghenv.Component.NickName = 'lb_envimetBuilding'
ghenv.Component.Message = 'VER 0.0.02\nMAR_30_2019'
ghenv.Component.IconDisplayMode = ghenv.Component.IconDisplayMode.application
ghenv.Component.Category = "lb_envimet"
ghenv.Component.SubCategory = "1 | Geometry"

import os
import sys
import scriptcontext as sc
import Grasshopper.Kernel as gh
import Rhino as rc
##################LB ENVI_MET###################
userPath = os.getenv("APPDATA")
path = os.path.join(userPath, "lb_envimet")
sys.path.append(path)
from Geometry import Grid, Building
################################################


def checkGeometry(geo):
    if type(geo) != type(rc.Geometry.Mesh()) or not geo.IsClosed:
        w = gh.GH_RuntimeMessageLevel.Warning
        message = "Please provide valid closed breps."
        ghenv.Component.AddRuntimeMessage(w, message)
        return -1
    return True


def main():
    if _geometry and checkGeometry(_geometry):
        # default materials
        if _wallMaterial_: wallMaterial = _wallMaterial_
        else: wallMaterial = "000000"
        if _roofMaterial_: roofMaterial = _roofMaterial_
        else: roofMaterial = "000000"
        
        bulding = Building(_geometry, wallMaterial, roofMaterial)
        
        if greenWallMaterial_: bulding.greenWallMaterial = greenWallMaterial_
        if greenRoofMaterial_: bulding.greenRoofMaterial = greenRoofMaterial_
        
        return bulding
    
    else:
        w = gh.GH_RuntimeMessageLevel.Warning
        message = "Please provide _buildings."
        ghenv.Component.AddRuntimeMessage(w, message)
        return -1


result = main()
if result != -1:
    envimetBuilding = result
# ---------- end lb_envimetbuilding ----------
lb_envimetbuilding_2 = Lb_envimetBuilding(geometry=brep_2, wallMaterial=list, greenWallMaterial=list_2, greenRoofMaterial=list_2)  # -> readMe, envimetBuilding; inputs geometry: Mesh; same code as lb_envimetbuilding

srf = Surface([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])
mjoin_2 = MeshJoin(Meshes=srf)
lb_envimethorizontaloverhang = Lb_envimetHorizontalOverhang(horizontalPlanarSurface=mjoin_2)  # -> readMe, envimetShadings; inputs horizontalPlanarSurface: Mesh
# ---------- lb_envimethorizontaloverhang: Python ----------
# lb_envimet: A series of component for ENVI_MET
# 
# It depends on Ladybug Legacy.
# 
# Copyright (c) 2013-2019, Antonello Di Nunzio <antonellodinunzio@gmail.com> 
# lb_envimet is free software; you can redistribute it and/or modify 
# it under the terms of the GNU General Public License as published 
# by the Free Software Foundation; either version 3 of the License, 
# or (at your option) any later version. 
# 
# lb_envimet is distributed in the hope that it will be useful,
# but WITHOUT ANY WARRANTY; without even the implied warranty of 
# MERCHANTABILITY or FITNESS FOR A PARTICULAR PURPOSE. See the 
# GNU General Public License for more details.
# 
# You should have received a copy of the GNU General Public License
# along with lb_envimet; If not, see <http://www.gnu.org/licenses/>.
# 
# @license GPL-3.0+ <http://spdx.org/licenses/GPL-3.0+>


"""
Use this component to generate ENVI-Met Horizontal shading for "lb_envimet Spaces".
-
Some components depend on Ladybug Legacy, please install Ladybug Legacy.
-
Provided by lb_envimet
    
    Args:
        _horizontalPlanarSurface: Horizoantal planar surface that represent ENVI-Met horazontal overhang 2d. Geometry must be horizonatal planar Surface or Brep.
        -
        Try to generate planar shadings using Ladybug!
        _singleWallId_: ENVI-Met singleWall id. You can use "id outputs" which comes from "lb_envimet Read Library".
    Returns:
        readMe!: ...
        envimetShadings: Connect this output to "lb_envimet Spaces" in order to add horizontal shadings to ENVI-Met model.
"""

ghenv.Component.Name = "lb_envimet Horizontal Overhang"
ghenv.Component.NickName = 'lb_envimetHorizontalOverhang'
ghenv.Component.Message = 'VER 0.0.02\nAPR_04_2019'
ghenv.Component.IconDisplayMode = ghenv.Component.IconDisplayMode.application
ghenv.Component.Category = "lb_envimet"
ghenv.Component.SubCategory = "1 | Geometry"


import os
import sys
import scriptcontext as sc
import Grasshopper.Kernel as gh
import Rhino as rc
##################LB ENVI_MET###################
userPath = os.getenv("APPDATA")
path = os.path.join(userPath, "lb_envimet")
sys.path.append(path)
from Geometry import SingleWall
################################################


def checkGeometry(geo):
    if type(geo) != type(rc.Geometry.Mesh()):
        w = gh.GH_RuntimeMessageLevel.Warning
        message = "Please provide valid breps."
        ghenv.Component.AddRuntimeMessage(w, message)
        return -1


def main():
    if _horizontalPlanarSurface:
        checkGeometry(_horizontalPlanarSurface)
        
        if _singleWallId_ != None: singleWallId = _singleWallId_
        else: singleWallId = "000001"
        
        # run envimet core
        envObj = SingleWall(_horizontalPlanarSurface, singleWallId)
        
        return envObj
        
    else:
        w = gh.GH_RuntimeMessageLevel.Warning
        message = "Please provide _horizontalPlanarSurface."
        ghenv.Component.AddRuntimeMessage(w, message)
        return -1

result = main()
if result != -1:
    envimetShadings = result
# ---------- end lb_envimethorizontaloverhang ----------

number_slider = Slider(2, range=1..3)

brep_3 = Brep(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)
brep_4 = Brep(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)
lb_envimet3dplant = Lb_envimet3DPlant(plant3D=brep_4, plant3Did=list_3)  # -> readMe, envimetPlant; inputs plant3D: Brep
#   port envimetPlant: Connect this output to "ENVI-Met Spaces" in order to add plants to ENVI-Met model.
# ---------- lb_envimet3dplant: Python ----------
# lb_envimet: A series of component for ENVI_MET
# 
# It depends on Ladybug Legacy.
# 
# Copyright (c) 2013-2019, Antonello Di Nunzio <antonellodinunzio@gmail.com> 
# lb_envimet is free software; you can redistribute it and/or modify 
# it under the terms of the GNU General Public License as published 
# by the Free Software Foundation; either version 3 of the License, 
# or (at your option) any later version. 
# 
# lb_envimet is distributed in the hope that it will be useful,
# but WITHOUT ANY WARRANTY; without even the implied warranty of 
# MERCHANTABILITY or FITNESS FOR A PARTICULAR PURPOSE. See the 
# GNU General Public License for more details.
# 
# You should have received a copy of the GNU General Public License
# along with lb_envimet; If not, see <http://www.gnu.org/licenses/>.
# 
# @license GPL-3.0+ <http://spdx.org/licenses/GPL-3.0+>


"""
Use this component to generate ENVI-Met 3D plants for "lb_envimet Spaces".
-
Some components depend on Ladybug Legacy, please install Ladybug Legacy.
-
Provided by lb_envimet
    
    Args:
        _plant3D_: Geometry that represent ENVI-Met plant 3d.  Geometry must be a Surface or Brep on xy plane.
        _plant3Did_: ENVI-Met plant3D id. You can use "id outputs" which comes from "lb_envimet Read Library".
        -
        E.g. PI,.Pinus Pinea
    Returns:
        readMe!: ...
        envimetPlants: Connect this output to "lb_envimet Spaces" in order to add plants to ENVI-Met model.
"""

ghenv.Component.Name = "lb_envimet 3D Plant"
ghenv.Component.NickName = 'lb_envimet3dPlant'
ghenv.Component.Message = 'VER 0.0.02\nMAR_30_2019'
ghenv.Component.IconDisplayMode = ghenv.Component.IconDisplayMode.application
ghenv.Component.Category = "lb_envimet"
ghenv.Component.SubCategory = "1 | Geometry"


import os
import sys
import scriptcontext as sc
import Grasshopper.Kernel as gh
import Rhino as rc
from copy import deepcopy
##################LB ENVI_MET###################
userPath = os.getenv("APPDATA")
path = os.path.join(userPath, "lb_envimet")
sys.path.append(path)
from Geometry import Plant3d
################################################


def checkGeometry(geo):
    if type(geo) != type(rc.Geometry.Brep()):
        w = gh.GH_RuntimeMessageLevel.Warning
        message = "Please provide valid breps."
        ghenv.Component.AddRuntimeMessage(w, message)
        return -1


def main():
    if _plant3D:
        
        checkGeometry(_plant3D)
        
        if _plant3Did_ != None: plant3Did = _plant3Did_
        else: plant3Did = "PI,.Pinus Pinea"
        
        # run envimet core
        envObj = Plant3d(_plant3D, plant3Did)
        
        return envObj
        
    else:
        w = gh.GH_RuntimeMessageLevel.Warning
        message = "Please provide _plant3D."
        ghenv.Component.AddRuntimeMessage(w, message)
        return -1


result = main()
if result != -1:
    envimetPlant = result
# ---------- end lb_envimet3dplant ----------
lb_envimet3dplant_2 = Lb_envimet3DPlant(plant3D=brep_3, plant3Did=list_3)  # -> readMe, envimetPlant; inputs plant3D: Brep; same code as lb_envimet3dplant

srf_2 = Surface(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)
# New behavior for objects and multiple material
srf_3 = Surface(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)
srf_4 = Surface(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)
lb_envimetsoil = Lb_envimetSoil(soil=srf_3, soilId=list_4)  # -> readMe, envimetSoil; inputs soil: Mesh
#   port envimetSoil: Connect this output to "ENVI-Met Spaces" in order to add soils to ENVI-Met model.
# ---------- lb_envimetsoil: Python ----------
# lb_envimet: A series of component for ENVI_MET
# 
# It depends on Ladybug Legacy.
# 
# Copyright (c) 2013-2019, Antonello Di Nunzio <antonellodinunzio@gmail.com> 
# lb_envimet is free software; you can redistribute it and/or modify 
# it under the terms of the GNU General Public License as published 
# by the Free Software Foundation; either version 3 of the License, 
# or (at your option) any later version. 
# 
# lb_envimet is distributed in the hope that it will be useful,
# but WITHOUT ANY WARRANTY; without even the implied warranty of 
# MERCHANTABILITY or FITNESS FOR A PARTICULAR PURPOSE. See the 
# GNU General Public License for more details.
# 
# You should have received a copy of the GNU General Public License
# along with lb_envimet; If not, see <http://www.gnu.org/licenses/>.
# 
# @license GPL-3.0+ <http://spdx.org/licenses/GPL-3.0+>


"""
Use this component to generate ENVI-Met inputs for "lb_envimet Spaces".
-
Some components depend on Ladybug Legacy, please install Ladybug Legacy.
-
Provided by lb_envimet
    
    Args:
        _soil: Geometry that represent ENVI-Met soil.  Geometry must be a Surface or Brep on xy plane.
        _soilId_: ENVI-Met profile id. You can use "id outputs" which comes from "lb_envimet Read Library".
        -
        E.g. L0
        baseSoilmaterial_: Connect a profileId that you want to use as base material of soil. If no id is provided it will be '000000'.
    Returns:
        readMe!: ...
        envimetSoils: Connect this output to "lb_envimet Spaces" in order to add soils to ENVI-Met model.
"""

ghenv.Component.Name = "lb_envimet Soil"
ghenv.Component.NickName = 'lb_envimetSoil'
ghenv.Component.Message = 'VER 0.0.02\nMAR_30_2019'
ghenv.Component.IconDisplayMode = ghenv.Component.IconDisplayMode.application
ghenv.Component.Category = "lb_envimet"
ghenv.Component.SubCategory = "1 | Geometry"


import os
import sys
import scriptcontext as sc
import Grasshopper.Kernel as gh
import Rhino as rc
##################LB ENVI_MET###################
userPath = os.getenv("APPDATA")
path = os.path.join(userPath, "lb_envimet")
sys.path.append(path)
from Geometry import Object2d
################################################



def checkGeometry(geo):
    if type(geo) != type(rc.Geometry.Mesh()):
        w = gh.GH_RuntimeMessageLevel.Warning
        message = "Please provide valid breps."
        ghenv.Component.AddRuntimeMessage(w, message)
        return -1


def main():
    if _soil:
        checkGeometry(_soil)
        
        if _soilId_ != None: soilId = _soilId_
        else: soilId = "000000"
        
        # run envimet core
        envObj = Object2d(_soil, soilId, 'Soil')
        
        return envObj
        
    else:
        w = gh.GH_RuntimeMessageLevel.Warning
        message = "Please provide _soil."
        ghenv.Component.AddRuntimeMessage(w, message)
        return -1


result = main()
if result != -1:
    envimetSoil = result
# ---------- end lb_envimetsoil ----------
lb_envimetsoil_2 = Lb_envimetSoil(soil=srf_4, soilId=list_6)  # -> readMe, envimetSoil; inputs soil: Mesh; same code as lb_envimetsoil
lb_envimetsoil_3 = Lb_envimetSoil(soil=srf_2, soilId=list_5)  # -> readMe, envimetSoil; inputs soil: Mesh; same code as lb_envimetsoil

lb_envimetgrid = Lb_envimetGrid(dimX=number_slider, dimY=number_slider)  # -> readMe, envimentGrid; inputs baseSurface: Surface, addCellsLeft: Int32, addCellslRight: Int32, addCellsUp: Int32, addCellsDown: Int32, numCellsZ: Int32
# ---------- lb_envimetgrid: Python ----------
# lb_envimet: A series of component for ENVI_MET
# 
# It depends on Ladybug Legacy.
# 
# Copyright (c) 2013-2019, Antonello Di Nunzio <antonellodinunzio@gmail.com> 
# lb_envimet is free software; you can redistribute it and/or modify 
# it under the terms of the GNU General Public License as published 
# by the Free Software Foundation; either version 3 of the License, 
# or (at your option) any later version. 
# 
# lb_envimet is distributed in the hope that it will be useful,
# but WITHOUT ANY WARRANTY; without even the implied warranty of 
# MERCHANTABILITY or FITNESS FOR A PARTICULAR PURPOSE. See the 
# GNU General Public License for more details.
# 
# You should have received a copy of the GNU General Public License
# along with lb_envimet; If not, see <http://www.gnu.org/licenses/>.
# 
# @license GPL-3.0+ <http://spdx.org/licenses/GPL-3.0+>


"""
Use this component to set ENVI-Met grid for "lb_envimet Spaces".
-
Some components depend on Ladybug Legacy, please install Ladybug Legacy.
-
Provided by lb_envimet
    
    Args:
        _baseSurface_: Connect a planar XY surface to create the grid base on a surface.
        dimX_: Size of grid cell in meter. Default value is 3.0.
        dimY_: Size of grid cell in meter. Default value is 3.0.
        dimZ_: Size of grid cell in meter. Default value is 3.0.
        numCellsZ_: Number grid for Height domain. Default 15
        _telescope_:    Choose telescope option if your Z domain can't be reached with equidistant Z grid. Default: 5 (growing percentage)
        startTelescopeHeight_: Height where to start the telesscoping Z grid growth. Default: 5.0
        addCellsLeft_: Default: 2
        addCellsUp_: Default: 2
        addCellslRight_: Default: 2
        addCellsDown_: Default: 2
    Returns:
        readMe!: ...
        envimentGrid: Connect this output to "lb_envimet Spaces" in order to add sources to ENVI-Met model.
"""

ghenv.Component.Name = "lb_envimet Grid"
ghenv.Component.NickName = 'lb_envimetGrid'
ghenv.Component.Message = 'VER 0.0.02\nMAR_30_2019'
ghenv.Component.IconDisplayMode = ghenv.Component.IconDisplayMode.application
ghenv.Component.Category = "lb_envimet"
ghenv.Component.SubCategory = "0 | Settings"


import os
import sys
import scriptcontext as sc
import Grasshopper.Kernel as gh
import Rhino as rc
##################LB ENVI_MET###################
userPath = os.getenv("APPDATA")
path = os.path.join(userPath, "lb_envimet")
sys.path.append(path)
from Geometry import Grid
################################################

def main():
    
    envimentGrid = Grid()
    
    if _telescope_:
        envimentGrid.telescope = _telescope_
        if _telescope_ >= 20.0:
            w = gh.GH_RuntimeMessageLevel.Warning
            message = "max telescope factor is 20."
            ghenv.Component.AddRuntimeMessage(w, message)
            envimentGrid.telescope = 20.0
    if _baseSurface_:
        envimentGrid.baseSurface = _baseSurface_
    if dimX_:
        envimentGrid.dimX = dimX_
    if dimY_:
        envimentGrid.dimY = dimY_
    if dimZ_:
        envimentGrid.dimZ = dimZ_
    if startTelescopeHeight_:
        envimentGrid.startTelescopeHeight = startTelescopeHeight_
    if addCellsLeft_:
        envimentGrid.extLeftXgrid = addCellsLeft_
    if addCellslRight_ and addCellslRight_ > 2:
        envimentGrid.extRightXgrid = addCellslRight_
    if addCellsUp_ and addCellsUp_ > 2:
        envimentGrid.extUpYgrid = addCellsUp_
    if addCellsDown_ and addCellsDown_ > 2:
        envimentGrid.extDownYgrid = addCellsDown_
    if numCellsZ_ and numCellsZ_ > 2:
        envimentGrid.numZ = numCellsZ_
    
    return envimentGrid


result = main()
if result != -1:
    envimentGrid = result
# ---------- end lb_envimetgrid ----------
lb_envimetmanageworkspace = Lb_envimetManageWorkspace(workspaceFolder="C:\lb_envimetPy")  # -> readMe, envimetFolder
# ---------- lb_envimetmanageworkspace: Python ----------
# lb_envimet: A series of component for ENVI_MET
# 
# It depends on Ladybug Legacy.
# 
# Copyright (c) 2013-2019, Antonello Di Nunzio <antonellodinunzio@gmail.com> 
# lb_envimet is free software; you can redistribute it and/or modify 
# it under the terms of the GNU General Public License as published 
# by the Free Software Foundation; either version 3 of the License, 
# or (at your option) any later version. 
# 
# lb_envimet is distributed in the hope that it will be useful,
# but WITHOUT ANY WARRANTY; without even the implied warranty of 
# MERCHANTABILITY or FITNESS FOR A PARTICULAR PURPOSE. See the 
# GNU General Public License for more details.
# 
# You should have received a copy of the GNU General Public License
# along with lb_envimet; If not, see <http://www.gnu.org/licenses/>.
# 
# @license GPL-3.0+ <http://spdx.org/licenses/GPL-3.0+>


"""
Use this component to create a Workspace folder.
-
This components depend on Ladybug Legacy, please install Ladybug Legacy.
-
Provided by lb_envimet
    
    Args:
        _workspaceFolder: Main folder where you have to save an Envimet project.
        _projectName: Name of Envimet project folder where you have to save:
        1) EnviMet geometry file (*.INX)
        2) Configuration file (*.SIMX)
        ENVImetInstallFolder_: Optional folder path for ENVImet4 installation folder.
    Returns:
        readMe!: ...
        envimetFolder: Envimet project folder. Connect it to "_folder" input of ENVI-Met Spaces
"""

ghenv.Component.Name = "lb_envimet Manage Workspace"
ghenv.Component.NickName = 'lb_envimetManageWorkspace'
ghenv.Component.Message = 'VER 0.0.02\nMAR_30_2019'
ghenv.Component.IconDisplayMode = ghenv.Component.IconDisplayMode.application
ghenv.Component.Category = "lb_envimet"
ghenv.Component.SubCategory = "0 | Settings"


import Grasshopper.Kernel as gh
import sys
import os
###################LB ENVI_MET###################
userPath = os.getenv("APPDATA")
path = os.path.join(userPath, "lb_envimet")
sys.path.append(path)
from IO import WorkspaceFolderLB
################################################


def checkInputs(workspaceFolder):
    if workspaceFolder == None:
        return False
    elif workspaceFolder:
        return True


def findENVI_MET():
    appdata = os.getenv("APPDATA")
    directory = os.path.join(appdata[:3], "ENVImet4\sys.basedata\\")
    
    if ENVImetInstallFolder_:
        directory = os.path.join(ENVImetInstallFolder_, 'sys.basedata\\')
    
    try:
        if os.listdir(directory):
            print("Good to go!")
            return directory
    except:
        w = gh.GH_RuntimeMessageLevel.Warning
        message = "Envimet Main Folder not found!"
        ghenv.Component.AddRuntimeMessage(w, message)
        return -1


def main():
    
    # default value
    if _projectName_ == None: projectFolderName = 'LB_ENVIMETDATA'
    else: projectFolderName = _projectName_
    
    
    mainDirectory = findENVI_MET()
    if mainDirectory != -1:
        
        # run envimet core
        myFile = WorkspaceFolderLB(_workspaceFolder, projectFolderName)
        fullFolder = myFile.writeWorkspaceFolder(mainDirectory)
        
        return fullFolder


# check and run component
if checkInputs(_workspaceFolder):
    result = main()
    if result != -1:
        envimetFolder = result
else:
    w = gh.GH_RuntimeMessageLevel.Warning
    message = "Please provide _workspaceFolder input."
    ghenv.Component.AddRuntimeMessage(w, message)
# ---------- end lb_envimetmanageworkspace ----------
lb_envimetlocation = Lb_envimetLocation(location=constructlocation)  # -> readMe, envimetLocation; inputs north: Int32
# ---------- lb_envimetlocation: Python ----------
# lb_envimet: A series of component for ENVI_MET
# 
# It depends on Ladybug Legacy.
# 
# Copyright (c) 2013-2019, Antonello Di Nunzio <antonellodinunzio@gmail.com> 
# lb_envimet is free software; you can redistribute it and/or modify 
# it under the terms of the GNU General Public License as published 
# by the Free Software Foundation; either version 3 of the License, 
# or (at your option) any later version. 
# 
# lb_envimet is distributed in the hope that it will be useful,
# but WITHOUT ANY WARRANTY; without even the implied warranty of 
# MERCHANTABILITY or FITNESS FOR A PARTICULAR PURPOSE. See the 
# GNU General Public License for more details.
# 
# You should have received a copy of the GNU General Public License
# along with lb_envimet; If not, see <http://www.gnu.org/licenses/>.
# 
# @license GPL-3.0+ <http://spdx.org/licenses/GPL-3.0+>


"""
Use this component to generate ENVI-Met location for "lb_envimet Spaces".
-
This components depend on Ladybug Legacy, please install Ladybug Legacy.
-
Provided by lb_envimet
    
    Args:
        _location: The output from the importEPW or constructLocation component.  This is essentially a list of text summarizing a location on the earth.
    Returns:
        readMe!: ...
        envimetLocation: Connect this output to "ENVI-Met Spaces" in order to add sources to ENVI-Met model.
"""

ghenv.Component.Name = "lb_envimet Location"
ghenv.Component.NickName = 'lb_envimetLocation'
ghenv.Component.Message = 'VER 0.0.02\nMAR_30_2019'
ghenv.Component.IconDisplayMode = ghenv.Component.IconDisplayMode.application
ghenv.Component.Category = "lb_envimet"
ghenv.Component.SubCategory = "0 | Settings"


import os
import sys
import scriptcontext as sc
import Grasshopper.Kernel as gh
import Rhino as rc
from copy import deepcopy
##################LB ENVI_MET###################
userPath = os.getenv("APPDATA")
path = os.path.join(userPath, "lb_envimet")
sys.path.append(path)
from Settings import LocationFromLB
################################################

initCheck = False
if sc.sticky.has_key('ladybug_release'):
    initCheck = True
else:
    initCheck = False
    print "You should first let the Ladybug fly..."
    w = gh.GH_RuntimeMessageLevel.Warning
    ghenv.Component.AddRuntimeMessage(w, "You should first let the Ladybug fly...")


if initCheck:
    if _location:
        if _north_ != None: north = _north_
        else: north = 0
        envimetLocation = LocationFromLB(_location, north)
# ---------- end lb_envimetlocation ----------

merge = Merge(Data1=lb_envimetsoil.envimetSoil, Data2=lb_envimetsoil_2.envimetSoil, Data3=lb_envimetsoil_3.envimetSoil)
toggle = BooleanToggle(True)
lb_envimetspaces = Lb_envimetSpaces(
    envimetFolder=lb_envimetmanageworkspace.envimetFolder,
    envimetLocation=lb_envimetlocation.envimetLocation,
    envimetGrid=lb_envimetgrid.envimentGrid,
    envimetObjects=flatten([lb_envimetbuilding.envimetBuilding, lb_envimetbuilding_2.envimetBuilding, merge, lb_envimet3dplant.envimetPlant, lb_envimet3dplant_2.envimetPlant, lb_envimethorizontaloverhang.envimetShadings]),
    fileName="NewLb",
    runIt=Toggle(False),
    viewGridXY=toggle,
    viewGridXZ=toggle)  # -> readMe, XYGrid, XZGrid, YZGrid, INXfileAddress; inputs envimetObjects: list, runIt: Boolean, viewGridXY: Boolean, viewGridXZ: Boolean, viewGridYZ: Boolean
# ---------- lb_envimetspaces: Python ----------
# lb_envimet: A series of component for ENVI_MET
# 
# It depends on Ladybug Legacy.
# 
# Copyright (c) 2013-2019, Antonello Di Nunzio <antonellodinunzio@gmail.com> 
# lb_envimet is free software; you can redistribute it and/or modify 
# it under the terms of the GNU General Public License as published 
# by the Free Software Foundation; either version 3 of the License, 
# or (at your option) any later version. 
# 
# lb_envimet is distributed in the hope that it will be useful,
# but WITHOUT ANY WARRANTY; without even the implied warranty of 
# MERCHANTABILITY or FITNESS FOR A PARTICULAR PURPOSE. See the 
# GNU General Public License for more details.
# 
# You should have received a copy of the GNU General Public License
# along with lb_envimet; If not, see <http://www.gnu.org/licenses/>.
# 
# @license GPL-3.0+ <http://spdx.org/licenses/GPL-3.0+>


"""
Use this component to generate ENVI-Met v4 3D geometry models.
-
Some components depend on Ladybug Legacy, please install Ladybug Legacy.
-
Provided by lb_envimet
    
    Args:
        _envimetFolder: Workspace folder which comes from lb_envimet ManageWorkspace"
        _envimetLocation: Location data which comes from "lb_envimet Location" component.
        --------------------: (...)
        _envimetGrid: Grid settings which comes from "lb_envimet Grid" component.
        nestingGrid_: Connect the output of "lb_envimet Nesting Grid".
        _envimetObjects_: Connect objects of lb_envimet you need in your model. The objects comes from:
        .
        1) "lb_envimet Building"
        .
        2) "lb_envimet Soil"
        .
        3) "lb_envimet 2D Plant"
        .
        4) "lb_envimet 3D Plant"
        .
        5) "lb_envimet Source"
        .
        6) "lb_envimet Terrain"
        --------------------: (...)
        fileName_: The file name that you would like the envimet model to be saved as. Default name is "LBenvimet".
        _runIt: Set to "True" to run the component and generate the envimet model.
        viewGridXY_: Set to "True" to view grid XY.
        viewGridXZ_: Set to "True" to view grid XZ.
        viewGridYZ_: Set to "True" to view grid YZ.
    Returns:
        readMe!: ...
        XYGrid: Preview of grid XY.
        XZGrid: Preview of 3D grid XZ.
        YZGrid: Preview of 3D grid YZ.
        INXfileAddress: The file path of the inx result file that has been generated on your machine.
"""

ghenv.Component.Name = "lb_envimet Spaces"
ghenv.Component.NickName = 'lb_envimetSpaces'
ghenv.Component.Message = 'VER 0.0.02\nMAR_30_2019'
ghenv.Component.IconDisplayMode = ghenv.Component.IconDisplayMode.application
ghenv.Component.Category = "lb_envimet"
ghenv.Component.SubCategory = "2 | Simulation"


import os
import re
import sys
import scriptcontext as sc
import Grasshopper.Kernel as gh
import Rhino as rc
from copy import deepcopy
##################LB ENVI_MET###################
userPath = os.getenv("APPDATA")
path = os.path.join(userPath, "lb_envimet")
sys.path.append(path)
from Geometry import Grid, Building, Dem, Object2d, NestingGrid, SingleWall
from IO.writeINX import *
################################################


def separateObjects(objects):
    
    buildings, terrain, plant3d, plant2d, soils, sources, singleWall  = [], None, [], [], [], [], []
    
    for obj in objects:
        if obj.__class__ is Building:
            buildings.append(obj)
        elif obj.__class__ is Dem:
            terrain = obj
        elif obj.__class__ is Plant3d:
            plant3d.append(obj)
        elif obj.__class__ is SingleWall:
            singleWall.append(obj)
        elif obj.name == 'Plant2d':
            plant2d.append(obj)
        elif obj.name == 'Soil':
            soils.append(obj)
        elif obj.name == 'Source':
            sources.append(obj)

    
    return buildings, terrain, plant3d, plant2d, soils, sources, singleWall


def createGrid(buildings, grid):
    
    baseObject = []
    
    if not grid.baseSurface:
        baseObject = [building.geometry for building in buildings]
    else:
        baseObject = [grid.baseSurface]
    
    if baseObject:
        grid.gZmethod(baseObject)
        gridXY = grid.gridPreviewXY()
        
        return gridXY
    else:
        w = gh.GH_RuntimeMessageLevel.Warning
        message = "Please provide envimetBuildings if your grid is based on buildings "\
        "or baseSurface if your grid is based on surface"
        ghenv.Component.AddRuntimeMessage(w, message)
        return -1


def checkDistanceFromBorder(points, buildings, grid):
    
    planeWorldXY = rc.Geometry.Plane.WorldXY
    
    ptMin = rc.Geometry.Point3d(min(points).X, min(points).Y, 0)
    ptMax = rc.Geometry.Point3d(max(points).X, max(points).Y, 0)
    border = rc.Geometry.Rectangle3d(planeWorldXY, ptMin, ptMax).ToNurbsCurve()
    
    # let's check!
    cornerStyle = rc.Geometry.CurveOffsetCornerStyle.Sharp
    firstCorner = rc.Geometry.Point3d(ptMin.X + grid.dimX, ptMin.Y + grid.dimY, 0)
    secondCorner = rc.Geometry.Point3d(ptMax.X - grid.dimX, ptMax.Y - grid.dimY, 0)
    firstCheck = rc.Geometry.Rectangle3d(planeWorldXY, firstCorner, secondCorner).ToNurbsCurve()
    
    geometry = [building.geometry for building in buildings]
    
    for index, building in enumerate(geometry):
        bbox = building.GetBoundingBox(True).ToBrep()
        xprj = rc.Geometry.Transform.PlanarProjection(planeWorldXY)
        bbox.Transform(xprj)
        
        for v in bbox.Vertices:
            if firstCheck.Contains(v.Location, planeWorldXY) == rc.Geometry.PointContainment.Outside:
                w = gh.GH_RuntimeMessageLevel.Warning
                message = "There is not enough space between the border and Building n°{0}."
                ghenv.Component.AddRuntimeMessage(w, message.format(index))
                return -1


def main():
    
    XYGrid, XZGrid, YZGrid, INXfileAddress = None, None, None, None
    
    # default materials
    if defaultSoilMaterial_ == None:
        defaultSoilMaterial = '000000'
    else:
        defaultSoilMaterial = defaultSoilMaterial_
    
    if defaultBuildingMaterial_ == None:
        buildingCommonMaterial = ['000000'] * 2
    else:
        buildingCommonMaterial = [defaultBuildingMaterial_] * 2
    
    # name of file
    if fileName_ == None:
        fileName = 'LBenvimet.INX'
    else:
        fileName = fileName_ + '.INX'
    
    if not os.path.exists(_envimetFolder):
        os.makedirs(_envimetFolder)
    fileAddress = _envimetFolder + '\\' + fileName
    
    if nestingGrid_:
        nesting = nestingGrid_
    else:
        nesting = NestingGrid()
    
    location = _envimetLocation.locationAttributes
    
    # separate objects
    try:
        buildings, terrain, plant3ds, plant2ds, soils, sources, singleWall = separateObjects(_envimetObjects_)
    except AttributeError:
        w = gh.GH_RuntimeMessageLevel.Warning
        message = "An input is missing. Please check it."
        ghenv.Component.AddRuntimeMessage(w, message)
        return -1
    
    if buildings or _envimetGrid:
        gridXY = createGrid(buildings, _envimetGrid)
        
        if viewGridXY_:
            XYGrid = _envimetGrid.gridPreviewXY()
        if viewGridXZ_:
            XZGrid = _envimetGrid.gridPreviewXZ()
        if viewGridYZ_:
            YZGrid = _envimetGrid.gridPreviewYZ()
    if _runIt:
            # preparation
            plant2d, source = _envimetGrid.emptyMatrix, _envimetGrid.emptyMatrix
            soil = re.sub('', defaultSoilMaterial, _envimetGrid.emptyMatrix)
            plant3d, shadings = '', ''
            
            # terrain
            demVoxel, demDBMatrix, dem2d = getDemMatrix(_envimetGrid, terrain)
            
            # buildings
            zeroMatrix = re.sub('', '0', _envimetGrid.emptyMatrix)
            IdMatrix, bottomMatrix, topMatrix = zeroMatrix, zeroMatrix, zeroMatrix
            wallDBMatrix, buildingNumberMatrix, greenIds, greenDBMatrix = '', '', '', ''
            
            buildingMatrix = [_envimetGrid.emptyMatrix , IdMatrix, bottomMatrix, topMatrix, buildingNumberMatrix, wallDBMatrix, greenIds, greenDBMatrix]
            
            if buildings:
                checkDistanceFromBorder(gridXY, buildings, _envimetGrid)
                IdMatrix, bottomMatrix, topMatrix, buildingNumberMatrix, wallDBMatrix, greenIds, greenDBMatrix = getBuildingPreparationMatrix(_envimetGrid, buildings, terrain, demVoxel)
                
                buildingMatrix = [_envimetGrid.emptyMatrix , IdMatrix, bottomMatrix, topMatrix, buildingNumberMatrix, wallDBMatrix, greenIds, greenDBMatrix]
            
            # other
            if plant3ds:
                plant3d = treeObjectMatrix(_envimetGrid, plant3ds)
            if plant2ds:
                plant2d = get2dObjectMatrix(_envimetGrid, plant2ds, '')
            if soils:
                soil = get2dObjectMatrix(_envimetGrid, soils, defaultSoilMaterial)
            if sources:
                source = get2dObjectMatrix(_envimetGrid, sources, '')
            if singleWall:
                shadings = getSimpleWall(_envimetGrid, singleWall)
            
            writeINX(fileAddress, _envimetGrid, _envimetLocation.locationAttributes, nesting, buildingMatrix, buildingCommonMaterial, dem2d, demDBMatrix, plant2d, plant3d, soil, source, shadings)
            INXfileAddress = fileAddress
        
    return XYGrid, XZGrid, YZGrid, INXfileAddress


if _envimetGrid and _envimetLocation and _envimetFolder:
    result = main()
    if result != -1:
        XYGrid, XZGrid, YZGrid, INXfileAddress = result
else:
    w = gh.GH_RuntimeMessageLevel.Warning
    message = "Please provide _envimetGrid, _envimetLocation and _envimetFolder."
    ghenv.Component.AddRuntimeMessage(w, message)
# ---------- end lb_envimetspaces ----------
