# Grasshopper definition BasicAndAdvancedSettings.gh (Grasshopper 0.9.76)
# plug-ins: Python Interpreter, ItemSelector

# 1) RUN LB
ladybug = Ladybug_Ladybug()  # -> Vviiiiiiiiiizzz; plug-in component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
list = ValueList({"Jerusalem": "https://www.energyplus.net/weather-download/europe_wmo_region_6/ISR//ISR_Jerusalem.401840_IWEC/all", "Rome - Ciampino": "https://www.energyplus.net/weather-download/europe_wmo_region_6/ITA//ITA_Roma-Ciampino.162390_IGDG/all"}, selected="Jerusalem")
epw_stat = Ladybug_OpenEPWAndSTATWeatherFiles(weatherFileURL=list)  # -> epwFile, statFile; plug-in component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

# ---- group: connect it if you do not want "telescopic grid"
number_slider = Slider(8, range=1..20)

# ----
# Connect a full path
# where you want to save
# and run your model
panel = Panel("C:\Envimet_LB_WS")

importlocation = Ladybug_ImportLocation(epwFile=epw_stat.epwFile)  # -> location; plug-in component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

# ---- group: Location
# 2) BASE SETTINGS
envi_metlocation = Ladybug_ENVIMetLocation(location=importlocation)  # -> readMe, envimetLocation; plug-in component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

# ---- group: Grid Settings
envi_metgrid = Ladybug_ENVIMetGrid(startTelescopeHeight=Slider(4, range=1..5))  # -> readMe, envimentGrid; plug-in component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

# ---- group: ENVI_MET workspace
envi_metmanageworkspace = Ladybug_ENVIMetManageWorkspace(workspaceFolder=panel)  # -> readMe, envimetFolder; plug-in component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

# ---- group: use it to find materials
envi_metreadlibrary = Ladybug_ENVIMetReadLibrary(dataType=Slider(6, range=0..6), keyword="olive")  # -> readMe, plant3DId, plant3DData; plug-in component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

envi_metreadlibrary_2 = Ladybug_ENVIMetReadLibrary(dataType=Slider(1, range=0..6), keyword="brick road")  # -> readMe, profileId, profileData; plug-in component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

envi_metreadlibrary_3 = Ladybug_ENVIMetReadLibrary(dataType=Slider(2, range=0..6), keyword="brick")  # -> readMe, materialId, materialData; plug-in component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

envi_metreadlibrary_4 = Ladybug_ENVIMetReadLibrary(dataType=Slider(5, range=0..6), keyword="grass")  # -> readMe, plantId, plantData; plug-in component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

# ----
list_2 = Honeybee_ItemSelector(envi_metreadlibrary.plant3DId, {"OT,.Olive tree", "OT,.Olive tree"}, selected="OT,.Olive tree")
list_3 = Honeybee_ItemSelector(envi_metreadlibrary_2.profileId, {"KK", "KG"}, selected="KK")
list_4 = Honeybee_ItemSelector(envi_metreadlibrary_2.profileId, {"KK", "KG"}, selected="KK")
list_5 = Honeybee_ItemSelector(envi_metreadlibrary_3.materialId, {"B1", "B2", "B3", "00"}, selected="B1")
list_6 = Honeybee_ItemSelector(envi_metreadlibrary_3.materialId, {"B1", "B2", "B3", "00"}, selected="B2")
srf = Surface([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])
list_7 = Honeybee_ItemSelector(envi_metreadlibrary_4.plantId, {"XX", "XX", "GG", "GB"}, selected="GG")
lng = ListLength(List=srf)
dup = DuplicateData(Data=list_2, Number=lng, Order=True)
srf_2 = Surface(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)
brep = Brep([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])
srf_3 = Surface([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])

# ---- group: building
envi_metbuilding = Ladybug_ENVIMetBuilding(buildings=brep, wallMaterial=[list_5, list_6])  # -> readMe, envimetBuildings; plug-in component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

# ---- group: 3d plants
envi_met3dplant = Ladybug_ENVIMet3DPlant(plant3D=srf, plant3Did=dup)  # -> readMe, envimetPlants; plug-in component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

# ---- group: soil
# 3) ENVI_MET OBJECTS
envi_metsoil = Ladybug_ENVIMetSoil(soil=srf_3, soilId=[list_3, list_4])  # -> readMe, envimetSoils; plug-in component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

# ---- group: 2d plants
envi_met2dplant = Ladybug_ENVIMet2DPlant(plant2D=srf_2, plantId=list_7)  # -> readMe, envimetPlants; plug-in component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

# ----
# 4) RUN IT!
toggle = BooleanToggle(False)

# ---- group: srf
srf_4 = Surface(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)

# ----
# Model Grid based
# on srf
envi_metspaces = Ladybug_ENVIMetSpaces(
    envimetLocation=envi_metlocation.envimetLocation,
    envimetGrid=envi_metgrid.envimentGrid,
    baseSurface=srf_4,
    envimetObjects=flatten([envi_metsoil.envimetSoils, envi_metbuilding.envimetBuildings, envi_met3dplant.envimetPlants, envi_met2dplant.envimetPlants]),
    envimetFolder=envi_metmanageworkspace.envimetFolder,
    fileName="ModelBasedOnSrf",
    runIt=toggle)  # -> readMe, gridPoints, INXfileAddress; plug-in component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

# ----
# 5) ADVANCED SETTINGS
number_slider_2 = Slider(1.3, range=1..1.5)
# 5) BASIC SETTINGS
envi_metstartdate = Ladybug_ENVIMetStartDate()  # -> readMe, date; plug-in component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
envi_met_mainsimsettings = Ladybug_ENVIMetMainSIMSettings(
    INXfileAddress=envi_metspaces.INXfileAddress,
    date=envi_metstartdate.date,
    totalTime=Slider(22, range=1..50),
    windSpeed=Slider(2.703, range=1..3),
    windDirection=Slider(49, range=1..90),
    roughness=Slider(0.08, range=0..1),
    initialTemperature=Slider(15.792, range=1..34),
    specificHumidity=Slider(1, range=0..1),
    relativeHumidity=Slider(74, range=1..100),
    outputIntervalMainFile=Slider(58.194, range=1..100),
    includeNestingGrids=Toggle(False))  # -> readMe, mainSettings; plug-in component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

number_slider_3 = Slider(8, range=1..30)
number_slider_4 = Slider(46, range=1..100)
number_slider_5 = Slider(1.21, range=1..1.5)
toggle_2 = BooleanToggle(False)
envi_metsoildatasettings = Ladybug_ENVIMetSoilDataSettings(
    initialTempUpperLayer=number_slider_3,
    initialTempMiddleLayer=number_slider_3,
    initialTempDeepLayer=number_slider_3,
    RHupperLayer=number_slider_4,
    RHmiddleLayer=number_slider_4,
    RHdeepLayer=number_slider_4)  # -> readMe, soilData; plug-in component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
envi_metplantmodelsettings = Ladybug_ENVIMetPlantModelSettings(CO2concentration=Slider(276.721, range=150..600))  # -> readMe, plantModel; plug-in component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
envi_metsimpleforcebyepw = Ladybug_ENVIMetSimpleForceByEPW(epwFile=epw_stat.epwFile, DOY=Slider(223, range=1..365))  # -> readMe, dryBulbTemperature, relativeHumidity, port, simpleForce; plug-in component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
envi_mettimestepssettings = Ladybug_ENVIMetTimestepsSettings()  # -> readMe, timesteps; plug-in component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
envi_metturbulencesettings = Ladybug_ENVIMetTurbulenceSettings(turbulence1d=toggle_2, turbulence3d=toggle_2, upperBoudary=toggle_2)  # -> readMe, turbulence; plug-in component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
envi_metcloudsettings = Ladybug_ENVIMetCloudSettings(lowValue=number_slider_5, middleValue=number_slider_5, highValue=number_slider_5)  # -> readMe, clouds; plug-in component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
envi_mettimingsettings = Ladybug_ENVIMetTimingSettings()  # -> readMe, timing; plug-in component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
envi_metsolaradjustsettings = Ladybug_ENVIMetSolarAdjustSettings(value=number_slider_2)  # -> readMe, solarAdjust; plug-in component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
envi_metlbcsettings = Ladybug_ENVIMetLBCSettings(lbcTq=Slider(2, range=0..6))  # -> readMe, lbcTypes; plug-in component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

# ----
# 6) RUN IT!
toggle_3 = BooleanToggle(False)
envi_metcoreconfiguration = Ladybug_ENVIMetCoreConfiguration(
    envimetFolder=envi_metmanageworkspace.envimetFolder,
    mainSettings=envi_met_mainsimsettings.mainSettings,
    timing=envi_mettimingsettings.timing,
    solarAdjust=envi_metsolaradjustsettings.solarAdjust,
    clouds=envi_metcloudsettings.clouds,
    timesteps=envi_mettimestepssettings.timesteps,
    soilData=envi_metsoildatasettings.soilData,
    plantModel=envi_metplantmodelsettings.plantModel,
    simpleForce=envi_metsimpleforcebyepw.simpleForce,
    lbcType=envi_metlbcsettings.lbcTypes,
    turbulence=envi_metturbulencesettings.turbulence,
    writeIt=toggle_3,
    runHeadquarter=Toggle(False))  # -> readMe, SIMfileAddress; plug-in component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
panel_2 = Panel(envi_metcoreconfiguration.readMe)
