# Grasshopper definition CreateUserProfileMaterial.gh (Grasshopper 0.9.76)
# plug-ins: Python Interpreter, ItemSelector

# 1) RUN LB
ladybug = Ladybug_Ladybug()  # -> Vviiiiiiiiiizzz; plug-in component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
list = ValueList({"Jerusalem": "https://www.energyplus.net/weather-download/europe_wmo_region_6/ISR//ISR_Jerusalem.401840_IWEC/all", "Rome - Ciampino": "https://www.energyplus.net/weather-download/europe_wmo_region_6/ITA//ITA_Roma-Ciampino.162390_IGDG/all"}, selected="Jerusalem")
epw_stat = Ladybug_OpenEPWAndSTATWeatherFiles(weatherFileURL=list)  # -> epwFile, statFile; plug-in component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

# ---- group: connect it if you do not want "telescopic grid"
number_slider = Slider(8, range=1..20)

# ----
# Connect a full path
# where you want to save
# and run your model
panel = Panel("C:\Envimet_LB_WS")

importlocation = Ladybug_ImportLocation(epwFile=epw_stat.epwFile)  # -> location; plug-in component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

# ---- group: Grid Settings
envi_metgrid = Ladybug_ENVIMetGrid(startTelescopeHeight=Slider(4, range=1..5))  # -> readMe, envimentGrid; plug-in component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

# ---- group: Location
# 2) BASE SETTINGS
envi_metlocation = Ladybug_ENVIMetLocation(location=importlocation)  # -> readMe, envimetLocation; plug-in component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

# ---- group: ENVI_MET workspace
envi_metmanageworkspace = Ladybug_ENVIMetManageWorkspace(workspaceFolder=panel)  # -> readMe, envimetFolder; plug-in component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

# ---- group: use it to find materials
envi_metreadlibrary = Ladybug_ENVIMetReadLibrary(dataType=Slider(6, range=0..6), keyword="olive")  # -> readMe, plant3DId, plant3DData; plug-in component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

envi_metreadlibrary_2 = Ladybug_ENVIMetReadLibrary(dataType=Slider(1, range=0..6), keyword="brick road")  # -> readMe, profileId, profileData; plug-in component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

envi_metreadlibrary_3 = Ladybug_ENVIMetReadLibrary(dataType=Slider(2, range=0..6), keyword="brick")  # -> readMe, materialId, materialData; plug-in component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

envi_metreadlibrary_4 = Ladybug_ENVIMetReadLibrary(dataType=Slider(5, range=0..6), keyword="grass")  # -> readMe, plantId, plantData; plug-in component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

# ----
list_2 = Honeybee_ItemSelector(envi_metreadlibrary.plant3DId, {"OT,.Olive tree", "OT,.Olive tree"}, selected="OT,.Olive tree")
list_3 = Honeybee_ItemSelector(envi_metreadlibrary_2.profileId, {"KK", "KG"}, selected="KK")
list_4 = Honeybee_ItemSelector(envi_metreadlibrary_3.materialId, {"B1", "B2", "B3", "00"}, selected="B1")
list_5 = Honeybee_ItemSelector(envi_metreadlibrary_3.materialId, {"B1", "B2", "B3", "00"}, selected="B2")
srf = Surface([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])
list_6 = Honeybee_ItemSelector(envi_metreadlibrary_4.plantId, {"XX", "XX", "GG", "GB"}, selected="GG")
lng = ListLength(List=srf)

# ---- group: User Soil Material
envi_metsoilmaterial = Ladybug_ENVIMetSoilMaterial(
    Id="MM",
    description="testMatSoil",
    versiegelung="1",
    waterContentatSaturation="0.00000",
    waterContentAtFieldCap="0.00000",
    waterContentWiltingPoint="0.00000",
    matrixPotential="0.00000",
    hidraulicConductivity="0.00000",
    volumetricHeatCapacity="2.00000",
    clappConstant="0.00000",
    heatConductivity="1.00000",
    naturalsoil=Toggle(True))  # -> readMe, userMaterial, soilId; plug-in component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
envi_metlayerprofilematerial = Ladybug_ENVIMetLayerProfileMaterial(layer1=envi_metsoilmaterial.soilId, layer2=envi_metsoilmaterial.soilId, layer3=envi_metsoilmaterial.soilId)  # -> readMe, layers; plug-in component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
groupprofilesoil = Ladybug_ENVIMetGroupProfileSoil({"Natural Surfaces": "Natural surfaces", "Road Pavements": "RoadsPavements", "Decorative", "Special Surfaces": "Special Sufaces", "Other": "other"}, selected="Decorative")
envi_metprofilematerial = Ladybug_ENVIMetProfileMaterial(
    Id="MA",
    description="Test User Material",
    microscaleRoughness="0.01",
    albedo="0.3",
    emissivity="0.9",
    groupProfileSoil=groupprofilesoil,
    layers=flatten(envi_metlayerprofilematerial.layers))  # -> readMe, userMaterial, profileId; plug-in component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
# 3) ENVI_MET USER MAT
envi_met_writeusermaterials = Ladybug_ENVIMetWriteUserMaterials(
    envimetFolder=envi_metmanageworkspace.envimetFolder,
    userMaterials=flatten([envi_metsoilmaterial.userMaterial, envi_metprofilematerial.userMaterial]),
    runIt=Toggle(False))  # -> readMe; plug-in component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

# ----
data = Data(envi_metprofilematerial.profileId)
dup = DuplicateData(Data=list_2, Number=lng, Order=True)
srf_2 = Surface([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])
brep = Brep([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])
srf_3 = Surface(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)

# ---- group: building
envi_metbuilding = Ladybug_ENVIMetBuilding(buildings=brep, wallMaterial=[list_4, list_5])  # -> readMe, envimetBuildings; plug-in component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

# ---- group: 3d plants
envi_met3dplant = Ladybug_ENVIMet3DPlant(plant3D=srf, plant3Did=dup)  # -> readMe, envimetPlants; plug-in component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

# ---- group: soil
# 4) ENVI_MET OBJECTS
envi_metsoil = Ladybug_ENVIMetSoil(soil=srf_2, profileId=[list_3, data])  # -> readMe, envimetSoils; plug-in component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

# ---- group: 2d plants
envi_met2dplant = Ladybug_ENVIMet2DPlant(plant2D=srf_3, plantId=list_6)  # -> readMe, envimetPlants; plug-in component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

# ----
# 5) RUN IT!
toggle = BooleanToggle(True)

# ---- group: srf
srf_4 = Surface(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)

# ----
# Model Grid based
# on srf
envi_metspaces = Ladybug_ENVIMetSpaces(
    envimetLocation=envi_metlocation.envimetLocation,
    envimetGrid=envi_metgrid.envimentGrid,
    baseSurface=srf_4,
    envimetObjects=flatten([envi_metsoil.envimetSoils, envi_metbuilding.envimetBuildings, envi_met3dplant.envimetPlants, envi_met2dplant.envimetPlants]),
    envimetFolder=envi_metmanageworkspace.envimetFolder,
    fileName="ModelBasedOnSrf",
    runIt=toggle)  # -> readMe, gridPoints, INXfileAddress; plug-in component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
